vi "Function.gvi"   [LabVIEW NXG 5.1.0]
panel controls:
  "file": path
  "file_2": path
  "Button": bool
  "stop": bool
panel indicators:
  "Token kód": f64[]
  "hátralévő kódok": i32[]
uses:
  NI::G Core::File IO (General)::Read Delimited Spreadsheet (DBL).gvi
  NI::G Core::File IO (General)::Write Delimited Spreadsheet (DBL).gvi
diagram:
  while {
    event {
      on "Token kód" Value changed {
        call "Read Delimited Spreadsheet (DBL).gvi"(file=$file) -> (all rows=w1)
        Delete From Array(inArray=w1, index0=0) -> (outArray=w2, deleted=w3)
        Array Size(array=w2) -> (size(s)=w4)
        $"hátralévő kódok" <- w4
        call "Write Delimited Spreadsheet (DBL).gvi"(file=$file_2, 2D data=w2)
        $"Token kód" <- w3
      }
    }
    stop if $stop
  }
